vi "Main.gviweb"   [LabVIEW NXG 3.0.0]
panel controls:
  "Send Log": bool
  "Stop Test": bool
  "Start Test": bool
  "Hyperlink Control": string = "/#testmonitor/testresults/config/filter%5BprogramNames%5D%5B0%5D=cRIO%20Test%20Cell&groupField=none"
panel indicators:
  "Disk Used %": f64
  "Memory Used %": f64
  "Files Sent": f64
  "Buffer": f64
  "Temperature": f64[][]
  "Testing": bool
  "Pressure": f64[][]
uses:
  NI::Skyline::Configuration::Open Configuration.gvi
  NI::Skyline::TagHTTP::Query Tags.gvi
  NI::Skyline::TagHTTP::Multi Read.gvi
  NI::Skyline::MessageHTTP::Open.gvi
  NI::Skyline::MessageHTTP::Publish.gvi
  NI::Skyline::MessageHTTP::Close.gvi
diagram:
  w1 = "http://demo.systemlink.io"  # Server
  call "Open Configuration.gvi"(server url=w1, username="lvuser", password="Demo1234!") -> (configuration=w2)
  w3 = "NI_cRIO-9049--SN-01234567--MAC-00-80-2F-AA-AA-AA"  # Target
  while {
    while {
      event (timeout = 500) {
        on Timeout {
          Concatenate Strings(w3, ".", "cRIO_Test_Cell.mod7.*") -> w4
          Build Array(w4) -> w5
          call "Query Tags.gvi"(paths=w5, configuration=w2) -> (tags=w6)
          call "Multi Read.gvi"(tags in=w6) -> (tag clusters=w7)
          for {
            w8 = each element of w7
            Property Node(instance in=w8) -> ("Value"=w10)
            Scan Value(format string="%f", string=w10) -> (value=w11)
            Build Array(w11) -> w12
            append w12 to w9
          }
          Transpose 2D Array(2D array=w9) -> (transposed array=w13)
          $Pressure <- w13
          w14 = ["Health.Disk.UsePercentage", "Health.Memory.UsePercentage", "cRIO_Test_Cell.files_sent", "cRIO_Test_Cell.buffer", "cRIO_Test_Cell.testing"]
          for {
            w15 = each element of w14
            Concatenate Strings(w3, ".", w15) -> w17
            append w17 to w16
          }
          call "Query Tags.gvi"(paths=w16, configuration=w2) -> (tags=w18)
          call "Multi Read.gvi"(tags in=w18) -> (tag clusters=w19)
          for {
            w20 = each element of w19
            Property Node(instance in=w20) -> ("Path"=w21, "Value"=w22)
            Search Or Split String(search string/char=".", string=w21) -> (match + rest of string=w23)
            case (w23) {
              frame ".Health.Disk.UsePercentage" {
                Scan Value(format string="%f", string=w22) -> (value=w24)
                $"Disk Used %" <- w24
              }
              frame ".Health.Memory.UsePercentage" {
                Scan Value(format string="%f", string=w22) -> (value=w25)
                $"Memory Used %" <- w25
              }
              frame ".cRIO_Test_Cell.files_sent" {
                Scan Value(format string="%d", string=w22) -> (value=w26)
                $"Files Sent" <- w26
              }
              frame ".cRIO_Test_Cell.buffer" {
                Scan Value(format string="%d", string=w22) -> (value=w27)
                $Buffer <- w27
              }
              frame ".cRIO_Test_Cell.testing" {
                case (w22) {
                  frame "False", Default {
                    w28 = FALSE
                  }
                  frame "True" {
                    w28 = TRUE
                  }
                }
                $Testing <- w28
              }
              frame Default { }
            }
          }
          Concatenate Strings(w3, ".", "cRIO_Test_Cell.mod1.*") -> w29
          Build Array(w29) -> w30
          call "Query Tags.gvi"(paths=w30, configuration=w2) -> (tags=w31)
          call "Multi Read.gvi"(tags in=w31) -> (tag clusters=w32)
          for {
            w33 = each element of w32
            Property Node(instance in=w33) -> ("Value"=w35)
            Scan Value(format string="%f", string=w35) -> (value=w36)
            Build Array(w36) -> w37
            append w37 to w34
          }
          Transpose 2D Array(2D array=w34) -> (transposed array=w38)
          $Temperature <- w38
        }
        on "Send Log" Value changed {
          call "Open.gvi"(configuration=w2) -> (message session out=w39, error out=w40)
          call "Publish.gvi"(message session=w39, topic=w3, message="Send File", error in=w40) -> (message session out=w41, error out=w42)
          call "Close.gvi"(message session=w41, error in=w42)
        }
        on "Start Test" Value changed {
          call "Open.gvi"(configuration=w2) -> (message session out=w43, error out=w44)
          call "Publish.gvi"(message session=w43, topic=w3, message="Start Test", error in=w44) -> (message session out=w45, error out=w46)
          call "Close.gvi"(message session=w45, error in=w46)
        }
        on "Stop Test" Value changed {
          call "Open.gvi"(configuration=w2) -> (message session out=w47, error out=w48)
          call "Publish.gvi"(message session=w47, topic=w3, message="Stop Test", error in=w48) -> (message session out=w49, error out=w50)
          call "Close.gvi"(message session=w49, error in=w50)
        }
      }
      stop if FALSE
    }
    stop if FALSE
  }
